# Grasshopper definition 0X-002.gh (Grasshopper 1.0.7)
# plug-ins: Robots

camera_magic = CameraMagic()  # -> R, T, C

# ---- group: .urp Program
robotsystem = RobotSystemParameter(camera_magic.R)
command = CommandParameter(camera_magic.C)
targets = TargetParameter(camera_magic.T)
program = CreateProgram(Name="shot_0X_002", RobotSystem=robotsystem, Targets=targets, InitCommands=command, StepSize=1)  # -> Program, Code, Duration, Warnings, Errors

# ---- group: Local Simulation
program_2 = ProgramParameter(program.Program)
sim = ProgramSimulation(Program=program_2, Time=Slider(0, range=0..1), Normalized=True)  # -> SystemMeshes, JointRotations, Plane, Index, Time, Program, Errors

# ---- group: Debugging
errors = Panel(program.Errors)
program_3 = Panel(program.Code)
warnings = Panel(program.Warnings)

# ---- group: Add a program call to the end of the .urp script
program_4 = ProgramParameter(program.Program)
code = Text(program.Code)
ins = InsertItems(List=code, Item="Program()", Indices=-1, Wrap=True)
custom = CustomCode(Program=program_4, Code=ins)

# ----
send_button = Button()

# ---- group: Remote Control
send_button_2 = Button()
program_5 = ProgramParameter(program.Program)
remote = RemoteConnection(Program=program_5, IP="10.0.0.10", Upload=send_button_2, Play=False, Pause=send_button)
panel = Panel(remote)

# ---- group: Save out .urp file
filepath = Panel("C:\Users\madel\Documents\robotics_in_animation\robotics_in_animation\stop_motion_files\urscript")
saveprog = SaveProgram(Program=custom, Folder=filepath)

# ==== cluster CameraMagic

# ---- group: Pose Generation / Frame Count
seconds = Slider(3.11, range=0..10)
fps = Slider(12, range=0..30)
multiplication = Multiplication(A=seconds, B=fps)
total_frame_count = Integer(multiplication)
panel = Panel(total_frame_count)

# ---- group: Make Initial Pop Up for Remote Safety
initial_pop_up_command = Panel("popup(\"Press 'Continue' to reset to Pose 0.\", title=\"Ready?\", blocking=True)")
customcmd = CustomCommand(Name="CustomCommand", Manufacturer="UR", Code=initial_pop_up_command)

# ----
# tool center point (tcp)
pt = Point(Point(0, -35, 110))
weight = Panel("2.0")
mesh = Mesh(<mesh referenced from the Rhino model>)
pl = ConstructPlane(Origin=pt, XAxis=Vector(1, 0, 0), YAxis="0,0,1")
tool = CreateTool(Name="Camera", TCP=pl, Weight=weight, Mesh=mesh)  # -> Tool, TCP

C = ClusterOutput(customcmd)

# ---- group: Robot System
list = RobotsLibrary({"UR3e", "UR5e", "UR10e", "UR16e", "UR3", "UR5", "UR10"}, selected="UR5e", Type=0)
loadrobot = LoadRobotSystem(Name=list, Base=PlaneXY(0, 0, 0))

# ----
R = ClusterOutput(loadrobot)
tool_2 = ToolParameter(tool.Tool)
zone = ZoneParameter(Slider(5, range=0..100))

# ---- group: Makes a pop up window with current pose number
# Full Pop Up Command: popup("Press 'Continue' to go to Pose", title="Ready?", blocking=True)
panel_2 = Panel("popup(\"Press 'Continue' to go to Pose ")

# ---- group: Pose Generation
camera_path = Curve(<curve referenced from the Rhino model>)
focal_path = Curve(<curve referenced from the Rhino model>)
series = Series(Start=0, Step=expr("1/(x-0)", total_frame_count), Count=expr("x+1", total_frame_count))
graph = GraphMapper(
    series,
    x0=0,
    x1=1,
    y0=0,
    y1=1,
    A=1,
    B=0,
    container_name="Linear",
    Graph_x0=0.25,
    Graph_x1=0.75,
    Graph_y0=0.25,
    Graph_y1=0.75)
graph_2 = GraphMapper(
    series,
    x0=0,
    x1=1,
    y0=0,
    y1=1,
    A=1,
    B=0,
    container_name="Linear",
    Graph_x0=0.25,
    Graph_x1=0.75,
    Graph_y0=0.25,
    Graph_y1=0.75)
eval = EvaluateCurve(Curve=reparameterize(camera_path), Parameter=graph)  # -> Point, Tangent, Angle
eval_2 = EvaluateCurve(Curve=reparameterize(focal_path), Parameter=graph_2)  # -> Point, Tangent, Angle
vec2pt = Vector2Pt(PointA=eval.Point, PointB=eval_2.Point, Unitize=False)  # -> Vector, Length
vdis = VectorDisplay(Anchor=eval.Point, Vector=vec2pt.Vector)
pl_2 = PlaneNormal(Origin=eval.Point, ZAxis=vec2pt.Vector)

# ---- group: compensate for new camera orientation
item = ListItem(List=eval.Point, Index=0, Wrap=True)
rot3d = Rotate3D(Geometry=pl_2, Angle=degrees(Slider(12, range=-360..360)), Center=item, Axis=Vector(0, 0, 1))  # -> Geometry, Transform

# ---- group: Pose Generation / Sets the Horizon Line: -90 for underslung shots, +90 for reaching shots
yz = YZPlane(Origin=Point(0, 0, 0))
prot = RotatePlane(Plane=yz, Angle=degrees(Slider(-90.215, range=-100..95)))
align = AlignPlanes(Planes=rot3d.Geometry, Master=prot)

# ---- group: Pose Generation (continued)
pflip = FlipPlane(Plane=align, ReverseX=False, ReverseY=Toggle(True), SwapAxes=True)

# ---- group: Target Generation
list_2 = FlagFields({"Shoulder": 1, "Elbow": 2, "Wrist": 4}, selected=[])
list_3 = ValueList({"Joint", "Linear"}, selected="Linear")
pln = Plane(pflip)
target = CreateTarget(Plane=pln, RobConf=list_2, Motion=list_3, Tool=tool_2, Speed=Slider(10, range=0..100), Zone=zone, IsCartesian=True)

# ---- group: Makes a pop up window with current pose number (continued)
number_of_poses = Integer(pln)
lng = ListLength(List=number_of_poses)
series_2 = Series(Start=1, Step=1, Count=expr("x-1", lng))
concat = Concatenate(FragmentA=panel_2, FragmentB=series_2)
concat_2 = Concatenate(FragmentA=concat, FragmentB=".\", title=\"Pose ")
concat_3 = Concatenate(FragmentA=concat_2, FragmentB=series_2)
concat_4 = Concatenate(FragmentA=concat_3, FragmentB="\", blocking=True)")

# ---- group: Target Generation (continued)
pop_up_commands = Text(concat_4)
customcmd_2 = CustomCommand(Name="CustomCommand", Manufacturer="UR", Code=pop_up_commands)

# ----
T = ClusterOutput(target)
